# Grasshopper definition basic_kitchenette_model.gh (Grasshopper 1.0.7)

length = Number()
depth = Number()
settings = Text()
config = Text()
length_2 = GetNumber(
    Slider(2000, range=1500..2500),
    AtLeast=1,
    AtMost=1,
    Maximum=1.797693135e+308,
    Minimum=-1.797693135e+308,
    TreeAccess=False)
depth_2 = GetNumber(Slider(600, range=300..900), AtLeast=1, AtMost=1, Maximum=1.797693135e+308, Minimum=-1.797693135e+308, TreeAccess=False)
length_3 = Number(length)
depth_3 = Number(depth)
length_4 = Number(length_2)
settings_2 = Text(settings)
config_2 = Text(config)
null = NullItem(Item=depth_3)  # -> NullFlags, InvalidFlags, Description
null_2 = NullItem(Item=length_3)  # -> NullFlags, InvalidFlags, Description
depth_4 = Number(depth_2)
filter = StreamFilter(Gate=null.NullFlags, Stream0=depth_3, Stream1=depth_4)
filter_2 = StreamFilter(Gate=null_2.NullFlags, Stream0=length_3, Stream1=length_4)

_3 = Brep(flatten(Tree({0}: [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], {1}: [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], {2}: [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], {3}: [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], {4}: [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], {5}: [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]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)))
_2 = Brep(flatten(Tree({0}: [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], {1}: [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], {2}: [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], {3}: [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], {4}: [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], {5}: [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]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)))
_1 = Brep(flatten(Tree({0}: [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], {1}: [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], {2}: [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], {3}: [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], {4}: [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], {5}: [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]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)))

c_script = CSharpScript(Depth=filter, Length=filter_2, Set1=_1, Set2=_2, Set3=_3)  # -> out, Breps; inputs Depth: Double, Length: Double, Set1: list of Brep, Set2: list of Brep, Set3: list of Brep
# ---------- c_script: C# ----------
    if (Depth > 650 && Length > 1900 && Length < 2100)
    {
      Print("Two");
      Breps = Set2;
    }
    else if (Depth > 650 && Length < 1900)
    {
      Print("Three");
      Breps = Set3;
    }
    else
    {
      Print("One");
      Breps = Set1;
    }
# ---------- end c_script ----------
breps = Breps(c_script.Breps)
