# Grasshopper definition subtract_forked_on_test09.gh (Grasshopper 1.0.7)
# plug-ins: Kangaroo2 Components

B = B()
# Another fork after the kangaroo change
A = A()
subtraction = Subtraction(A=A, B=B)
R = Result(subtraction)
cluster = Cluster()
coplanar = CoPlanar(Strength=1)

# ==== cluster Cluster
A = ClusterInput()
B = ClusterInput()
addition = Addition(A=A, B=B)
R = ClusterOutput(addition)
