# Grasshopper definition test_single_cluster_240506.gh (Grasshopper 1.0.8)

cluster = Cluster()

# ==== cluster Cluster
B = ClusterInput()
A = ClusterInput()
subtraction = Subtraction(A=A, B=B)
R = ClusterOutput(subtraction)
